# Dynamo graph Замечания по проекту.dyn (Dynamo 2.16.4.10216)
# packages: DynamoPilot 1.0.0

# group: Выбираем проект для которого будем выгружать замечания
selectDocuments = SelectDocumentsNode()

# group: Данные для шапки отчета
code_block = CodeBlock { " "; "Замечания по проекту"; }
getDisplayName = DataObject.Properties.GetDisplayName(dataObject=selectDocuments)
list_create = List.Create(item0=code_block.out1, item1=getDisplayName)
flatten = List.Flatten(list=list_create)
join = String.Join(separator=code_block.out0, string0=flatten)

# group: Создаем шапку отчета
code_block_2 = CodeBlock { ["ФИО","Дата","Тип","Текст"]; }
list_create_2 = List.Create(item0=join, item1=code_block_2)

# group: Получаем тип "Папка замечаний к документу"
code_block_3 = CodeBlock { "doc_remarksFolder"; }
getTypeByName = Type.Get.GetTypeByName(name=code_block_3)
getId = Type.Properties.GetId(pilotType=getTypeByName)

# group: Получаем все типы у которых могут быть замечания
allTypes = Type.Get.AllTypes()
getChildren = Type.Properties.GetChildren(pilotType=allTypes)
contains = List.Contains(list=getChildren, item=getId, lacing=Longest)
filterByBoolMask = List.FilterByBoolMask(list=allTypes, mask=contains)
getId_2 = Type.Properties.GetId(pilotType=filterByBoolMask.in)
flatten_2 = List.Flatten(list=getId_2)

# group: Получаем документы с замечаниями в выбранном проекте
getСhildrenByTypeId = DataObject.Get.GetСhildrenByTypeId(pDataObject=selectDocuments, id=flatten_2, lacing=Longest)
flatten_3 = List.Flatten(list=getСhildrenByTypeId)
getChildren_2 = DataObject.Properties.GetChildren(dataObject=flatten_3)
getByGuid = DataObject.Get.GetByGuid(id=getChildren_2)
getType = DataObject.Properties.GetType(dataObject=getByGuid)
getId_3 = Type.Properties.GetId(pilotType=getType)
contains_2 = List.Contains(list=getId_3, item=getId, lacing=Longest)
filterByBoolMask_2 = List.FilterByBoolMask(list=flatten_3, mask=contains_2)

# group: Группируем документы по папкам
getParentId = DataObject.Properties.GetParentId(dataObject=filterByBoolMask_2.in)
getByGuid_2 = DataObject.Get.GetByGuid(id=getParentId)
groupByKey = List.GroupByKey(list=filterByBoolMask_2.in, keys=getByGuid_2)

getDisplayName_2 = DataObject.Properties.GetDisplayName(dataObject=groupByKey.groups)

# group: Получаем замечания из документов
code_block_4 = CodeBlock { "doc_issue"; }
getTypeByName_2 = Type.Get.GetTypeByName(name=code_block_4)
getId_4 = Type.Properties.GetId(pilotType=getTypeByName_2)
getСhildrenByTypeId_2 = DataObject.Get.GetСhildrenByTypeId(pDataObject=groupByKey.groups, id=getId_4)

getAttributes = DataObject.Properties.GetAttributes(dataObject=getСhildrenByTypeId_2)

# group: Получаем инициатора замечания
code_block_5 = CodeBlock { ", "; }
code_block_6 = CodeBlock(a=getAttributes) { a["initiator"]; }
getByPositionId = Person.Get.GetByPositionId(id=code_block_6)
getDisplayName_3 = Person.Properties.GetDisplayName(pPerson=getByPositionId)
join_2 = String.Join(separator=code_block_5, string0=getDisplayName_3)

# group: Дата создания замечания
getCreated = DataObject.Properties.GetCreated(dataObject=getСhildrenByTypeId_2)

# group: Тип замечания
getType_2 = DataObject.Properties.GetType(dataObject=getСhildrenByTypeId_2)
getTitle = Type.Properties.GetTitle(pilotType=getType_2)

# group: Текст замечания
code_block_7 = CodeBlock(a=getAttributes) { a["text"]; }

# group: Выравниваем списки
code_block_8 = CodeBlock { 2; 1; }
flatten_4 = List.Flatten(list=join_2, amount=code_block_8.out0)
flatten_5 = List.Flatten(list=getCreated, amount=code_block_8.out1)
flatten_6 = List.Flatten(list=getTitle, amount=code_block_8.out1)
flatten_7 = List.Flatten(list=code_block_7, amount=code_block_8.out1)

# group: Создаем основые строки
list_create_3 = List.Create(item0=flatten_4, item1=flatten_5, item2=flatten_6, item3=flatten_7)
transpose = List.Transpose(lists=list_create_3)
transpose_2 = List.Transpose(lists=transpose@L3)

# group: Добавляем имена папок
addItemToFront = List.AddItemToFront(item=getDisplayName_2@L2, list=transpose_2@L3)
code_block_9 = CodeBlock { 1; }
flatten_8 = List.Flatten(list=addItemToFront, amount=code_block_9)

join_3 = List.Join(list0=list_create_2, list1=flatten_8)

# group: Выгружаем в ексель
code_block_10 = CodeBlock { "ВАШ_ПУТЬ\\Замечания по проекту.xlsx"; "default"; 0; true; }
openXMLExportExcel = Data.OpenXMLExportExcel(filePath=code_block_10.out0, sheetName=code_block_10.out1, data=join_3, overWrite=code_block_10.out3)
