# Dynamo graph Отчет по замороженным элементам.dyn (Dynamo 2.16.4.10216)
# packages: DynamoPilot 1.0.0

# group: замароженные/не замороженные
boolean = BoolSelector(true)

# group: Создаем шапку
code_block = CodeBlock { "Список не замороженных элементов"; "Список замороженных элементов"; ["№","Наименование"]; }
if_ = RefactoredIf(test=boolean, true=code_block.out0, false=code_block.out1)
list_create = List.Create(item0=if_, item1=code_block.out2)

# group: Выбираем проект
selectDocuments = SelectDocumentsNode()

# group: Создаем условие поиска
boolean_2 = BoolSelector(true)
createObjectQueryBuilder = Search.SearchBuilder.CreateObjectQueryBuilder(updater=boolean_2)
getId = DataObject.Properties.GetId(dataObject=selectDocuments)
filterByContextId = Search.Filters.ObjectFilters.FilterByContextId(builder=createObjectQueryBuilder, id=getId)
selectObjectState = ObjectStateDropdown("Frozen")
filterByObjectState = Search.Filters.ObjectFilters.FilterByObjectState(builder=filterByContextId, objectState=selectObjectState, reverse=boolean)

# group: Загружаем объекты
byCustomBuilder = Search.Search.ByCustomBuilder(builder=filterByObjectState)
getByGuid = DataObject.Get.GetByGuid(id=byCustomBuilder)
flatten = List.Flatten(list=getByGuid)

# group: Формируем основные строки
code_block_2 = CodeBlock { 1; }
count = List.Count(list=flatten)
range = Range(start=code_block_2, end=count)
getDisplayName = DataObject.Properties.GetDisplayName(dataObject=flatten)
list_create_2 = List.Create(item0=range, item1=getDisplayName)
transpose = List.Transpose(lists=list_create_2)

# group: Сшиваем и выравниваем
list_create_3 = List.Create(item0=list_create, item1=transpose)
code_block_3 = CodeBlock { 1; }
flatten_2 = List.Flatten(list=list_create_3, amount=code_block_3)

# group: Экспорт в ексель
code_block_4 = CodeBlock { "ВАШ_ПУТЬ\\Отчет по замороженным элементам.xlsx"; "default"; 0; true; }
openXMLExportExcel = Data.OpenXMLExportExcel(filePath=code_block_4.out0, sheetName=code_block_4.out1, data=flatten_2, startRow=code_block_4.out2, startColumn=code_block_4.out2, overWrite=code_block_4.out3, writeAsString=code_block_4.out3)
