# Dynamo graph Форматы страниц документов проекта (by python).dyn "Форматы страниц документов проекта" (Dynamo 2.16.4.10216)
# packages: DynamoPilot 1.0.0

# group: Выбираем проект
selectDocuments = SelectDocumentsNode()

# group: Создаем шапку
code_block = CodeBlock { "Форматы страниц документов проекта "; }
getDisplayName = DataObject.Properties.GetDisplayName(dataObject=selectDocuments)
code_block_2 = CodeBlock(a=code_block, b=getDisplayName) { [a,b[0]]; }
concat = String.Concat(string0=code_block_2)

# group: Получаем все типы у которых могут быть файлы
allTypes = Type.Get.AllTypes()
getHasFiles = Type.Properties.GetHasFiles(pilotType=allTypes)
filterByBoolMask = List.FilterByBoolMask(list=allTypes, mask=getHasFiles)
getId = Type.Properties.GetId(pilotType=filterByBoolMask.in)

# group: Получаем все обьекты в выбраном проекте
getСhildrenByTypeId = DataObject.Get.GetСhildrenByTypeId(pDataObject=selectDocuments, id=getId, lacing=Longest)
flatten = List.Flatten(list=getСhildrenByTypeId)

# group: Обрабатываем обьекты в python
python_script = Python(IN[0]=flatten)  # CPython3
# ---------- python_script.python (336 lines) ----------
# -*- coding: utf-8 -*-
import sys, re, math, clr

# DesignScript
clr.AddReference('ProtoGeometry')
from Autodesk.DesignScript.Geometry import *

# .NET
clr.AddReference('System')
clr.AddReference('System.Core')
clr.AddReference('WindowsBase')   # System.IO.Packaging.Package
clr.AddReference('System.Xml')
clr.AddReference('System.Xml.Linq')

from System.IO import File, FileMode, FileAccess, FileShare, MemoryStream
from System.IO.Packaging import Package
from System.Xml.Linq import XElement

# Pilot/DynamoPilot
clr.AddReference('DynamoPilot')
from DynamoPilot.Data import StaticMetadata

# Попытаемся достать DataObject.Get для загрузки родителя по Guid
DataGet = None
try:
    import DataObject
    from DataObject import Get as DataGet
except:
    DataGet = None  # если класса нет — заголовок группы будет пустым

entries = IN[0] or []

# ---- константы/кэш ----
FIXED_PAGE_CT = "application/vnd.ms-package.xps-fixedpage+xml"
paper_size_cache = {}  # key: file.Id (Guid->str) -> (names_csv, page_count)

# ---- утилиты ----
def is_xps_like(name_or_path):
    return bool(name_or_path) and re.search(r'\.(xps|dwfx)$', str(name_or_path), re.IGNORECASE) is not None

def to_dpi(mm_str):
    try: mm = int(mm_str)
    except: mm = 0
    return int((mm / 25.4) * 96)

def from_dpi_to_mm(value):
    try: return str(int(round((value / 96.0) * 25.4)))
    except: return "0"

class PaperSize(object):
    __slots__ = ("Name", "Width", "Height")
    def __init__(self, name, width, height):
        self.Name = name; self.Width = int(width); self.Height = int(height)

STANDARDS = [
    PaperSize("C1",   to_dpi("648"), to_dpi("917")),
    PaperSize("C2",   to_dpi("458"), to_dpi("648")),
    PaperSize("C3",   to_dpi("324"), to_dpi("458")),
    PaperSize("C4",   to_dpi("229"), to_dpi("324")),
    PaperSize("B1",   to_dpi("707"), to_dpi("1000")),
    PaperSize("B2",   to_dpi("500"), to_dpi("707")),
    PaperSize("B3",   to_dpi("353"), to_dpi("500")),
    PaperSize("B4",   to_dpi("250"), to_dpi("353")),
    PaperSize("A2x4", to_dpi("594"), to_dpi("1682")),
    PaperSize("A2x3", to_dpi("594"), to_dpi("1261")),
    PaperSize("A3x5", to_dpi("420"), to_dpi("1487")),
    PaperSize("A3x4", to_dpi("420"), to_dpi("1189")),
    PaperSize("A3x3", to_dpi("420"), to_dpi("892")),
    PaperSize("A4x5", to_dpi("297"), to_dpi("1051")),
    PaperSize("A4x4", to_dpi("297"), to_dpi("841")),
    PaperSize("A4x3", to_dpi("297"), to_dpi("631")),
    PaperSize("A0",   to_dpi("841"), to_dpi("1189")),
    PaperSize("A1",   to_dpi("594"), to_dpi("841")),
    PaperSize("A2",   to_dpi("420"), to_dpi("594")),
    PaperSize("A3",   to_dpi("297"), to_dpi("420")),
    PaperSize("A4",   to_dpi("210"), to_dpi("297")),
    PaperSize("A5",   to_dpi("148"), to_dpi("210")),    
]

def get_delta_fitted(w, h, wc, hc, percentage_error=1):
    w, h  = (min(w,h), max(w,h))
    wc, hc= (min(wc,hc), max(wc,hc))
    delta = (w * percentage_error) / 100.0
    if (wc + delta) >= w and (hc + delta) >= h:
        return ((wc + delta) - w) * ((hc + delta) - h)
    return -1.0

def closest_paper_size(page_w, page_h):
    # нормируем ориентацию
    w, h = (min(page_w, page_h), max(page_w, page_h))

    # 1) точное совпадение
    for s in STANDARDS:
        sw, sh = (min(s.Width, s.Height), max(s.Width, s.Height))
        if sw == w and sh == h:
            return s

    # 2) допуск: берем максимум из 1% и 3 мм
    def mm_to_px(mm): return int(round((mm / 25.4) * 96))
    tol_px = max(int(round(max(w, h) * 0.01)), mm_to_px(3))

    best = None
    best_err = 10**9  # “лучшее” = минимальная сумма модулей отклонений

    for s in STANDARDS:
        sw, sh = (min(s.Width, s.Height), max(s.Width, s.Height))
        dw, dh = abs(sw - w), abs(sh - h)
        if dw <= tol_px and dh <= tol_px:
            err = dw + dh
            if err < best_err:
                best_err = err
                best = s

    if best is not None:
        return best

    # 3) не попало ни в один стандарт — оставляем как “ммxмм”
    return PaperSize("{}x{}".format(from_dpi_to_mm(page_w), from_dpi_to_mm(page_h)), page_w, page_h)


def to_seekable(stream):
    ms = MemoryStream()
    try:
        try: stream.Position = 0
        except: pass
        stream.CopyTo(ms); ms.Position = 0
        return ms
    finally:
        try: stream.Close()
        except: pass

def enumerate_fixedpages(pkg):
    parts = list(pkg.GetParts())
    fixed_like = [p for p in parts if p.ContentType and ("fixedpage" in p.ContentType.lower())]
    if fixed_like:
        for p in fixed_like: yield p; return
    exact = [p for p in parts if p.ContentType == FIXED_PAGE_CT]
    if exact:
        for p in exact: yield p; return
    for p in parts:
        inner = None
        try:
            inner = p.GetStream()
            xel = XElement.Load(inner)
            ln = xel.Name.LocalName if xel is not None else ""
            if ln.lower() == "fixedpage": yield p
        except:
            pass
        finally:
            if inner is not None: inner.Close()

def read_page_sizes_from_seekable(ms):
    pkg = None
    try:
        pkg = Package.Open(ms)
        pages = list(enumerate_fixedpages(pkg))
        seen = set(); unique_sizes = []

        def get_attr_local(elem, name):
            try:
                for a in elem.Attributes():
                    try:
                        if a.Name.LocalName == name:
                            return a.Value
                    except: pass
            except: pass
            return None

        for part in pages:
            inner = None
            try:
                inner = part.GetStream()
                xel = XElement.Load(inner)
                w_str = get_attr_local(xel, "Width")
                h_str = get_attr_local(xel, "Height")
                w = int(round(float(w_str))) if w_str else 0
                h = int(round(float(h_str))) if h_str else 0
                ps = closest_paper_size(w, h)
                key = tuple(sorted((ps.Width, ps.Height)))
                if key not in seen:
                    seen.add(key); unique_sizes.append(ps)
            finally:
                if inner is not None: inner.Close()
        return unique_sizes, len(pages)
    finally:
        if pkg is not None: pkg.Close()
        try: ms.Position = 0
        except: pass

def unwrap_if_pfile(file_obj):
    try:
        if hasattr(file_obj, "Unwrap"):
            return file_obj.Unwrap()
    except: pass
    return file_obj

def open_read_via_provider(file_obj):
    f = unwrap_if_pfile(file_obj)
    try: fname = f.Name
    except: fname = "file"
    try:
        fid = f.Id; fid = str(fid) if fid is not None else None
    except: fid = None
    s = StaticMetadata.FileProvider.OpenRead(f)
    if s is None: return (None, fid, fname)
    return (to_seekable(s), fid, fname)

def pick_first_xps_file(entry):
    # PDataObject с Files
    files = None
    try: files = entry.Files
    except: files = None
    if files is not None:
        for pf in files:
            try: nm = pf.Name
            except: nm = None
            if nm and is_xps_like(nm):
                return ('file', pf)
        return (None, None)
    # Сам файл
    try: nm = entry.Name
    except: nm = None
    if nm and is_xps_like(nm):
        return ('file', entry)
    # Путь
    if isinstance(entry, str) and is_xps_like(entry):
        return ('path', entry)
    return (None, None)

def entry_display(entry):
    for prop in ("DisplayName", "Title", "Name"):
        try:
            v = getattr(entry, prop)
            if v: return str(v)
        except: pass
    return str(entry)

def entry_typename(entry):
    try:
        t = getattr(entry, "Type", None)
        if t is None: return ""
        for prop in ("DisplayName","Name"):
            try:
                v = getattr(t, prop)
                if v: return str(v)
            except: pass
    except: pass
    return ""

def entry_parent_id(entry):
    try:
        pid = getattr(entry, "ParentId")
        return str(pid) if pid is not None else ""
    except:
        return ""

def is_empty_guid(g):
    if not g: return True
    sg = str(g).lower()
    return sg in ("00000000-0000-0000-0000-000000000000", "{00000000-0000-0000-0000-000000000000}")

# ---- группировка по ParentId ----
groups = {}              # parentId -> [entries...]
order_parent_ids = []    # порядок групп — по первому появлению
for e in entries:
    kind, target = pick_first_xps_file(e)
    if kind is None:
        # не документ — пропускаем (это не элемент списка для отчёта)
        continue
    pid = entry_parent_id(e)
    key = pid if (pid and not is_empty_guid(pid)) else "__NO_PARENT__"
    if key not in groups:
        groups[key] = []
        order_parent_ids.append(key)
    groups[key].append(e)

# ---- имя родителя через DataObject.Get ----
def parent_title_for(pid_key):
    if pid_key in ("", "__NO_PARENT__"):
        return ""  # без заголовка
    # пробуем DataObject.Get.GetByStrGuid
    if DataGet is not None:
        try:
            p = DataObject.Get.GetByStrGuid(pid_key)
            if p is not None:
                return entry_display(p) or ""
        except:
            pass
    # если не удалось — ничего не пишем
    return ""

# ---- формирование строк как на скрине ----
rows = []  # каждая строка: [Левый текст, Формат]

for pid in order_parent_ids:
    title = parent_title_for(pid)
    if title:
        rows.append([title, ""])  # заголовок раздела (только слева)

    counter = 0
    for e in groups[pid]:
        counter += 1

        # формат по первому XPS/DWFX
        sizes_str = ""
        kind, target = pick_first_xps_file(e)
        if kind == 'path':
            try:
                fs = File.Open(target, FileMode.Open, FileAccess.Read, FileShare.ReadWrite)
                ms = to_seekable(fs)
                sizes, _ = read_page_sizes_from_seekable(ms)
                sizes_str = ", ".join([ps.Name for ps in sizes]) if sizes else ""
            except:
                sizes_str = ""
        else:
            ms, fid, fname = open_read_via_provider(target)
            if fid and fid in paper_size_cache:
                sizes_str, _ = paper_size_cache[fid]
            else:
                if ms is not None:
                    try:
                        sizes, _ = read_page_sizes_from_seekable(ms)
                        sizes_str = ", ".join([ps.Name for ps in sizes]) if sizes else ""
                        if fid:
                            paper_size_cache[fid] = (sizes_str, 0)
                    finally:
                        try: ms.Close()
                        except: pass

        left = "{} - {}".format(counter, entry_display(e))
        tname = entry_typename(e)
        if tname:
            left += " - " + tname
        rows.append([left, sizes_str or ""])

OUT = rows
# ----------------------------------------

# group: Экспорт в ексель
code_block_3 = CodeBlock { "ВАШ_ПУТЬ\\Форматы страниц документов проекта.xlsx"; "default"; 0; true; }
join = List.Join(list0=concat, list1=python_script)
openXMLExportExcel = Data.OpenXMLExportExcel(filePath=code_block_3.out0, sheetName=code_block_3.out1, data=join, startRow=code_block_3.out2, startColumn=code_block_3.out2, overWrite=code_block_3.out3, writeAsString=code_block_3.out3)
